% Simulink data dictionary flyBallDB.sldd

ay = Simulink.Signal(StorageClass="SimulinkGlobal")
y = Simulink.Signal(StorageClass="SimulinkGlobal")
vy = Simulink.Signal(StorageClass="SimulinkGlobal")
reward = Simulink.Signal(StorageClass="SimulinkGlobal")
Sig = Simulink.Signal()